# Grasshopper definition Mamba-ShapeDiverEdition2.2-RHINO7.gh (Grasshopper 1.0.7)
# Copyright: CreativeCommons ShareALikeNotComercial
# Copyright: CC BY-NC-SA
# plug-ins: ShapeDiverForGrasshopper, Pufferfish

# https://shapediverdownloads.s3.amazonaws.com/staticassets/bunny.obj
panel = Panel("https://raw.githubusercontent.com/EDUARDOCHAMORRO/ModelStorage/main/3DPrintCylinder.obj")
sddb = ShapeDiverDatabase({AbsoluteTolerance=0, AngleTolerance=0, AppDescription="", AppName="ShapediverVersion1test", DocumentName="ShapediverVersion1test*", InputGroups="{}", OutputGroups="{\"5540ab0f-16d8-4ae1-b707-5359cdf12ba9\":{\"name\":\"ShapeDiver Output\",\"guid\":\"5540ab0f-16d8-4ae1-b707-5359cdf12ba9\",\"index\":0,\"params\":[\"f13881f7-744f-4d09-b95f-d7272b669848\"],\"indexFloor\":0,\"indexCeiling\":0}}", RelativeTolerance=0, UnitSystem=0})
# MACHINE CONFIGURATION AND AUTOMATIC GEOMETRY LOCATION
# https://raw.githubusercontent.com/EDUARDOCHAMORRO/ModelStorage/main/3DPrintCylinder.stl
import_stl = ImportGeometry(URI=panel, maximum_file_size=10485760, selected_file_formats="application/wavefront-obj,model/stl")  # -> Object, Material

# ---- group: Printer Configuration
cartesian_printer_measure_y = Slider(235, range=0..1000)
cartesian_printer_height_z = Slider(235, range=0..1000)
printer_type = ValueList({"Cartesian": 0, "Delta": 1}, selected="Cartesian")
cartesian_printer_measure_x = Slider(235, range=0..1000)

# ----
null_item = NullItem(Item=import_stl.Object)  # -> NullFlags, InvalidFlags, Description
triangulate = Triangulate(Mesh=import_stl.Object)  # -> Mesh, Count
rebuild_mesh = RebuildMesh(
    Mesh=triangulate.Mesh,
    RebuildNormals="1",
    CullUnused=False,
    UnifyNormals="1",
    FlipNormals=False,
    IdenticalCombine="1",
    WeldVertices=0)
geometry = Geometry(rebuild_mesh)
null = NullItem()  # -> NullFlags, InvalidFlags, Description
number_slider = Slider(1, range=0..10)
panel_2 = Panel("""mm Diameter
mm in Z""")
unit_z = UnitZ(Factor="0.1")
preset_material = PresetMaterial(Color=RGB(255, 255, 255), MaterialIndex="400")
range = Range(Domain="0 to 3", Steps="2")

# ---- group: Print Settings
print_speed_f_mm_s = Slider(700, range=0..3000)
jog_speed_f_mm_s = Slider(2000, range=0..5000)
flow = Slider(100, range=0..500)
z_offset = Slider(0, range=-10..10)
direct_text_input = DirectTextInput(maxlength=100, text="PrintFilename")

# ---- group: Slicing Settings
slicing_distance = Slider(1.5, range=0..10)
noozle_diameter = Slider(3, range=0..6)
create_base = BooleanToggle(False)
base_layers = Slider(2, range=1..5)
spiralize = BooleanToggle(False)
adjust_seam = Slider(0.2, range=0..1)
walls = Slider(1, range=0..10)

# ----
multiplication = Multiplication(A=noozle_diameter, B="1.2")
preset_material_2 = PresetMaterial(Color=ColourSwatch(SwatchColor=RGB(54, 54, 54)), MaterialIndex="200")
stream_filter = StreamFilter(Gate=null_item.NullFlags, Stream0=" Good")
cluster = Cluster_3()
concatenate = Concatenate(FragmentA="FileImport:", FragmentB=null_item.Description)
concatenate_2 = Concatenate(FragmentA=concatenate, FragmentB=stream_filter)

position_on_bed = Point("{0.5,0.5,0}")
printer_type_2 = Boolean(printer_type)
delta_printer_height = Number(cartesian_printer_height_z)
printer_height_z = Number(cartesian_printer_height_z)
printer_measure_y = Number(cartesian_printer_measure_y)
printer_measure_x = Number(cartesian_printer_measure_x)
delta_printer_measure_diameter = Number(cartesian_printer_measure_x)
geometry_2 = Geometry(geometry)
null_item_2 = NullItem(Item=printer_measure_x)  # -> NullFlags, InvalidFlags, Description
null_item_3 = NullItem(Item=delta_printer_height)  # -> NullFlags, InvalidFlags, Description
null_item_4 = NullItem(Item=position_on_bed)  # -> NullFlags, InvalidFlags, Description
null_item_5 = NullItem(Item=printer_height_z)  # -> NullFlags, InvalidFlags, Description
null_item_6 = NullItem(Item=printer_type_2)  # -> NullFlags, InvalidFlags, Description
null_item_7 = NullItem(Item=printer_measure_y)  # -> NullFlags, InvalidFlags, Description
list_length = ListLength(List=geometry_2)
null_item_8 = NullItem(Item=delta_printer_measure_diameter)  # -> NullFlags, InvalidFlags, Description
stream_filter_2 = StreamFilter(Gate=null_item_2.NullFlags, Stream0=printer_measure_x, Stream1="200")
equality = Equality(FirstNumber=list_length, SecondNumber="1")  # -> Equality, Inequality
stream_filter_3 = StreamFilter(Gate=null_item_3.NullFlags, Stream0=delta_printer_height, Stream1="200")
stream_filter_4 = StreamFilter(Gate=null_item_5.NullFlags, Stream0=printer_height_z, Stream1="200")
stream_filter_5 = StreamFilter(Gate=null_item_4.NullFlags, Stream0=position_on_bed, Stream1="{0.5,0.5,0}")
stream_filter_6 = StreamFilter(Gate=null_item_7.NullFlags, Stream0=printer_measure_y, Stream1="200")
stream_filter_7 = StreamFilter(Gate=null_item_6.NullFlags, Stream0=printer_type_2, Stream1="0")
stream_filter_8 = StreamFilter(Gate=null_item_8.NullFlags, Stream0=delta_printer_measure_diameter, Stream1="200")
stream_gate = StreamGate(Stream=geometry_2, Gate=equality.Equality)  # -> Target0, Target1
printer_measure_x_2 = Number(stream_filter_2)
printer_measure_y_2 = Number(stream_filter_6)
printer_height_z_2 = Number(stream_filter_4)
delta_printer_measure_diameter_2 = Number(stream_filter_8)
delta_printer_height_2 = Number(stream_filter_3)
delta_printer = Boolean(stream_filter_7)
position_on_bed_2 = Point(stream_filter_5)
expression = Expression(x=printer_measure_y_2, Expression="x/2")
expression_2 = Expression(x=printer_measure_x_2, Expression="x/2")
expression_3 = Expression(x=printer_height_z_2, Expression="x/2")
mesh = Mesh(stream_gate.Target1)
delta_printer_2 = Boolean(delta_printer)
expression_4 = Expression(x=delta_printer_measure_diameter_2, Expression="x/2")
pt = ConstructPoint(XCoordinate=expression_2, YCoordinate=expression, PrinterHeightZ=expression_3)
cyl = Cylinder(Base=PlaneXY(0, 0, 0), Radius=expression_4, Length=delta_printer_height_2)
box = CenterBox(Base=pt, PrinterMeasureX=expression_2, PrinterMeasureY=expression, PrinterHeightZ=expression_3)
debrep = DeconstructBrep(Brep=cyl)  # -> Faces, Edges, Vertices
geometry_3 = Geometry(mesh)
bbox = BoundingBox(Content=flatten(geometry_3), Plane=PlaneXY(0, 0, 0), UnionBox=True)  # -> Box, Box_2
item = ListItem(List=debrep.Edges, Index="3", Wrap=True)
edges = BrepEdges(Brep=cyl)  # -> Naked, Interior, NonManifold
edges_2 = BrepEdges(Brep=box)  # -> Naked, Interior, NonManifold
boundary = BoundarySurfaces(Edges=item)
evaluate_surface = EvaluateSurface(Surface=reparameterize(boundary), Point=position_on_bed_2)  # -> Point, Normal, UDirection, VDirection, Frame
center_of_delta = Point(evaluate_surface.Point)
box_2 = EvaluateBox(Box=bbox.Box, UParameter=0.5, VParameter=0.5, WParameter=0)  # -> Plane, Point, Include
debrep_2 = DeconstructBrep(Brep=box)  # -> Faces, Edges, Vertices
item_2 = ListItem(List=edges.Naked, Index="1", Wrap=True)
item_3 = ListItem(List=debrep_2.Faces, Index="4", Wrap=True)
merge = Merge(Data1=item_2, Data2=boundary)
evaluate_surface_2 = EvaluateSurface(Surface=reparameterize(item_3), Point=position_on_bed_2)  # -> Point, Normal, UDirection, VDirection, Frame
center_of_cartesian = Point(evaluate_surface_2.Point)
filter = StreamFilter(Gate=delta_printer_2, Stream0=center_of_cartesian, Stream1=center_of_delta)
vec2pt = Vector2Pt(PointA=box_2.Point, PointB=filter, Unitize=False)  # -> Vector, Length
merge_2 = Merge(Data1=edges_2.Interior, Data2=item_3)
geo = Geometry(merge)
move = Move(Geometry=geometry_3, Motion=vec2pt.Vector)  # -> Geometry, Transform
geo_2 = Geometry(merge_2)
filter_2 = StreamFilter(Gate=delta_printer_2, Stream0=geo_2, Stream1=geo)
unit_z_2 = UnitZ(Factor="10")
geometry_4 = Geometry(filter_2)
filter_3 = StreamFilter(Gate=delta_printer_2, Stream0=box, Stream1=cyl)
move_2 = Move(Geometry=move.Geometry, Motion=unit_z_2)  # -> Geometry, Transform
cap = CapHoles(Brep=filter_3)
settings_quality = SettingsQuality()
mesh_brep = MeshBrep(Brep=cap, Settings=settings_quality)
deconstruct_mesh = DeconstructMesh(Mesh=move_2.Geometry)  # -> Vertices, Faces, Colours, Normals
brepinc = PointInBrep(Brep=cap, Point=deconstruct_mesh.Vertices, Strict=False)
mesh_inclusion = MeshInclusion(Mesh=mesh_brep, Point=deconstruct_mesh.Vertices, Strict="1")  # disabled
equals = Equality(FirstNumber=brepinc, SecondNumber="1")  # -> Equality, Inequality
panel_3 = Panel(brepinc)
ma = MassMultiplication(Input=brepinc)  # -> Result, PartialResults
ma_2 = MassAddition(Input=equals.Inequality)  # -> Result, PartialResults
ma_3 = MassMultiplication(Input=equals.Inequality)  # -> Result, PartialResults
swatch = ColourSwatch(SwatchColor=RGB(0, 124, 186))
swatch_2 = ColourSwatch(SwatchColor=RGB(128, 0, 0))
panel_4 = Panel(ma_2.Result)
equals_2 = Equality(FirstNumber=ma_3.Result, SecondNumber="0")  # -> Equality, Inequality
panel_5 = Panel(equals_2.Inequality)
filter_4 = StreamFilter(Gate=equals_2.Inequality, Stream0=ColourSwatch(SwatchColor=RGB(99, 99, 99)), Stream1=swatch_2)
null_2 = NullItem(Item=equals_2.Inequality)  # -> NullFlags, InvalidFlags, Description
centered_geometry = Geometry(move.Geometry)
filter_5 = StreamFilter(Gate=equality.Inequality, Stream0=filter_4, Stream1=swatch_2)
null_3 = NullItem(Item=geometry_2)  # -> NullFlags, InvalidFlags, Description
filter_6 = StreamFilter(Gate=null_2.NullFlags, Stream0=filter_5, Stream1=swatch_2)
filter_7 = StreamFilter(Gate=null_3.NullFlags, Stream0=filter_6, Stream1=ColourSwatch(SwatchColor=RGB(222, 222, 222)))
null_4 = NullItem(Item=centered_geometry)  # -> NullFlags, InvalidFlags, Description
filter_8 = StreamFilter(Gate=equality.Inequality, Stream0=centered_geometry)
printer_geometry = Geometry(filter_2)
preset_material_3 = PresetMaterial(Color=filter_7, MaterialIndex="100")
centered_geometry_2 = Geometry(filter_8)

null_5 = NullItem(Item=geometry_3)  # -> NullFlags, InvalidFlags, Description
ma_4 = MassAddition(Input=flatten([null_5.NullFlags, null.NullFlags]))  # -> Result, PartialResults
equals_3 = Equality(FirstNumber=ma_4.Result, SecondNumber="0")  # -> Equality, Inequality
ma_5 = MassMultiplication(Input=[null_5.NullFlags, null.NullFlags])  # -> Result, PartialResults
geometry_5 = Geometry(geometry_4)
filter_9 = StreamFilter(Gate=null_5.NullFlags, Stream0="Your print is a Mesh", Stream1="Your print is a Brep")
filter_10 = StreamFilter(Gate=ma_5.Result, Stream0="Your print is a Brep and a Mesh")
filter_11 = StreamFilter(Gate=equals_3.Equality, Stream1="Please connect only Brep or Mesh.Not both")
filter_12 = StreamFilter(Gate=null_4.NullFlags, Stream0="No errors,you are good to go", Stream1="Geometry is out of bounds")
filter_13 = StreamFilter(Gate=ma_5.Result, Stream1=filter_9)
merge_3 = Merge(Data1=filter_9)
filter_14 = StreamFilter(Gate=equals_3.Equality, Stream0=filter_12, Stream1="Fatal Error")
data = Data(bbox.Box)
debox = DeconstructBox(Box=data)  # -> Plane, X, Y, Z
bnd = Bounds(Numbers=debox.Z)
bnd_2 = Bounds(Numbers=debox.X)
bnd_3 = Bounds(Numbers=debox.Y)
dedomain = DeconstructDomain(Domain=bnd)  # -> Start, End
dedomain_2 = DeconstructDomain(Domain=bnd_2)  # -> Start, End
dedomain_3 = DeconstructDomain(Domain=bnd_3)  # -> Start, End
round = Round(Number=dedomain.Start)  # -> Nearest, Floor, Ceiling
round_2 = Round(Number=dedomain_3.Start)  # -> Nearest, Floor, Ceiling
round_3 = Round(Number=dedomain_2.Start)  # -> Nearest, Floor, Ceiling
pt_2 = ConstructPoint(XCoordinate=round_3.Nearest, YCoordinate=round_2.Nearest, ZCoordinate=round.Nearest)
expression_5 = Expression(P=pt_2, Expression="Format(\"Print Size X{0:0}mm Y{1:0}mm Z{2:0}mm\", P.x, P.y, P.z)")
filter_15 = StreamFilter(Gate=equals_3.Equality, Stream0=expression_5)
merge_4 = Merge(Data1=filter_11, Data2=filter_14, Data3=merge_3, Data4=filter_15)
filter_16 = StreamFilter(Gate=equality.Inequality, Stream0=merge_4, Stream1="Fatal Error - Input only one geometry")
log_file = Data(filter_16)
panel_6 = Panel(log_file)
data_2 = Data(filter_7)
list_item = ListItem(List=printer_geometry, Index=-1, Wrap=True)
cull_index = CullIndex(List=printer_geometry, Indices=-1, Wrap=True)
brep_edges = BrepEdges(Brep=list_item)  # -> Naked, Interior, NonManifold
dash_pattern = DashPattern(Curve=reparameterize(cull_index), Pattern=range)  # -> graft(Dashes), Gaps
shapediver_material = ShapeDiverMaterial(Color=swatch, Opacity="0.1", FlatShading=False)
move_3 = Move(Geometry=centered_geometry_2, Motion=unit_z)  # -> Geometry, Transform
datablue = Data(swatch)
merge_5 = Merge(Data1=dash_pattern.Dashes, Data2=brep_edges.Naked)  # -> flatten(Result)
datagrey = Data(data_2)

shapediver_display = ShapeDiverDisplay(Geometry=move_3.Geometry, ShapeDiverMaterial=shapediver_material)
shapediver_display_2 = ShapeDiverDisplay(Geometry=merge_5, ShapeDiverMaterial=preset_material_3)

# ----
# SLICER TOOL
mamba_fullslicer = MambaFullSlicer(
    geometry=centered_geometry_2,
    slicing_distance=slicing_distance,
    noozle_diameter=noozle_diameter,
    create_base=create_base,
    number_of_base_layers=base_layers,
    base_infill_wall_offset=multiplication,
    base_infill_line_distance=multiplication,
    spiralize=spiralize,
    adjust_seam_position=adjust_seam,
    number_of_walls=walls)  # -> polyline_3, settings_flow_4, messages
panel_7 = Panel(mamba_fullslicer.messages)
cluster_2 = Cluster_2(list=mamba_fullslicer.settings_flow_4, A=flow)
shapediver_display_3 = ShapeDiverDisplay(Geometry=mamba_fullslicer.polyline_3, ShapeDiverMaterial=preset_material_2)
cluster_3 = Cluster(
    sliced_geometry=mamba_fullslicer.polyline_3,
    settings_flow=mamba_fullslicer.settings_flow_4,
    print_speed_f_mm_s=print_speed_f_mm_s,
    jog_speed_f_mm_s=jog_speed_f_mm_s,
    extruding_amount_e=cluster_2,
    z_base_offset=z_offset,
    start_endgcode=cluster)

# ----
# Text input: Double-click on the component to define a default text and the maximum lenght for the string typed by the user.
# 
# Rename the component to define the parameter name on ShapeDiver.
# Export with properties
list = ValueList({"txt", "g", "gcode", "csv", "xml", "json", "ifc"}, selected="gcode")
list_2 = ValueList({"ASCII", "UTF_8"}, selected="ASCII")
list_3 = ValueList({"CRLF", "LF", "CR"}, selected="CRLF")
text_export_options = TextExportOptions(Extension=list, EndOfLine=list_3, Encoding=list_2, N=False)
file_format_restrictions = Panel(text_export_options)
text = Text(cluster_3)
file_name = Panel("PrintFile")
download_g_code = DownloadExport(Data=text, Options=text_export_options, Name=direct_text_input)

# ---- group: OBJECT DIMENSIONS
bbox_2 = BoundingBox(Content=flatten(geometry_5), Plane=PlaneXY(0, 0, 0), UnionBox=True)  # -> Box, Box_2
volume = Volume(Geometry=bbox_2.Box)  # -> Volume, Centroid
project = Project(Geometry=volume.Centroid, Plane=PlaneXY(0, 0, 0))  # -> Geometry, Transform
scale = Scale(Geometry=bbox_2.Box, Center=project.Geometry, Factor="1.1")  # -> Geometry, Transform
brep_edges_2 = BrepEdges(Brep=scale.Geometry)  # -> Naked, Interior, NonManifold
panel_8 = Panel("""0
3
11""")
list_item_2 = ListItem(List=brep_edges_2.Interior, Index=panel_8, Wrap=True)
length = Length(Curve=list_item_2)
division = Division(A=length, B="1.1")
subtraction = Subtraction(A=length, B=division)
division_2 = Division(A=subtraction, B="2")
negative = Negative(Value=division_2)
extend_curve = ExtendCurve(Curve=list_item_2, Type=0, Start=negative, End=negative)
list_item_3 = ListItem(List=extend_curve, Index=0, Wrap=True)  # -> Item1, Item, Item1_2
end_points = EndPoints(Curve=list_item_3.Item1)  # -> Start, End
deconstruct = Deconstruct(Point=end_points.Start)  # -> XComponent, YComponent, ZComponent
negative_2 = Negative(Value=deconstruct.ZComponent)
unit_z_3 = UnitZ(Factor=negative_2)
move_4 = Move(Geometry=list_item_3.Item1, Motion=unit_z_3)  # -> Geometry, Transform
merge_6 = Merge(Data1=list_item_3.Item, Data2=list_item_3.Item1_2, Data3=move_4.Geometry)
panel_9 = Panel("""mm in X
mm in Y
mm in Z""")
evaluate_curve = EvaluateCurve(Curve=reparameterize(graft(merge_6)), Parameter="0.5")  # -> Point, Tangent, Angle
perp_frames = PerpFrames(Curve=merge_6, Count=10, Align=reverse("1"))  # -> Frames, Parameters
curve_middle = CurveMiddle(Curve=merge_6)
deconstruct_plane = DeconstructPlane(Plane=perp_frames.Frames)  # -> Origin, XAxis, YAxis, ZAxis
construct_plane = ConstructPlane(Origin=evaluate_curve.Point, XAxis=evaluate_curve.Tangent, YAxis=expr("-x", deconstruct_plane.YAxis))
list_item_4 = ListItem(List=construct_plane, Index=0, Wrap=True)  # -> flatten(Item)
dispatch = Dispatch(List=list_item_4, DispatchPattern=[True, True, False])  # -> ListA, ListB
list_item_5 = ListItem(List=curve_middle, Index=-1, Wrap=True)
panel_10 = Panel(construct_plane)
rotate = Rotate(Geometry=dispatch.ListB, Angle=degrees(-90), Plane=list_item_5)  # -> Geometry, Transform
xz_plane = XZPlane(Origin=rotate.Geometry)
rotate_2 = Rotate(Geometry=rotate.Geometry, Angle=degrees("180"), Plane=xz_plane)  # -> Geometry, Transform
preset_material_4 = PresetMaterial(Color=datagrey, MaterialIndex="100")

# ----
cull_index_2 = CullIndex(List=merge_6, Indices=1, Wrap=True)
stream_filter_9 = StreamFilter(Gate=printer_type, Stream0=merge_6, Stream1=cull_index_2)
stream_filter_10 = StreamFilter(Gate=printer_type, Stream0=panel_9, Stream1=panel_2)
cull_index_3 = CullIndex(List=merge_6, Indices=1, Wrap=True)
stream_filter_11 = StreamFilter(Gate=printer_type, Stream0=merge_6, Stream1=cull_index_3)
list_item_6 = ListItem(List=dispatch.ListA, Index=0, Wrap=True)
stream_filter_12 = StreamFilter(Gate=printer_type, Stream0=[dispatch.ListA, rotate_2.Geometry], Stream1=[list_item_6, rotate_2.Geometry])

# ---- group: OBJECT DIMENSIONS (continued)
length_2 = Length(Curve=stream_filter_9)
concatenate_3 = Concatenate(FragmentA=length_2, FragmentB=stream_filter_10)
shapediver_display_4 = ShapeDiverDisplay(Geometry=stream_filter_11, ShapeDiverMaterial=preset_material_4)
text_tag_3d = TextTag3D(Location=flatten(stream_filter_12), Text=concatenate_3, Size="4", Colour=datagrey, Justification=8)

# ----
geometry_6 = Geometry(bbox_2.Box)
panel_11 = Panel("""3
5""")
brep_edges_3 = BrepEdges(Brep=geometry_6)  # -> Naked, Interior, NonManifold
unit_x = UnitX(Factor="10")
cull_index_4 = CullIndex(List=mamba_fullslicer.settings_flow_4, Indices=panel_11, Wrap=True)
list_item_7 = ListItem(List=brep_edges_3.Interior, Index="9", Wrap=True)
panel_12 = Panel("""Print Status: 
Create Base: 
Layer Height: 
Noozle Diameter: 
Number of Walls: 
Print Speed: 
Jog Speed: 
Flow %: 
Z-Offset: """)
merge_7 = Merge(Data1=flatten(cull_index_4), Data2=print_speed_f_mm_s, Data3=jog_speed_f_mm_s, Data4=flow, Data5=z_offset)  # -> flatten(Result)
end_points_2 = EndPoints(Curve=list_item_7)  # -> Start, End
move_5 = Move(Geometry=end_points_2.End, Motion=unit_x)  # -> Geometry, Transform
merge_8 = Merge(Data1=panel_7, Data2=merge_7)  # -> flatten(Result)
xz_plane_2 = XZPlane(Origin=move_5.Geometry)
concatenate_4 = Concatenate(FragmentA=panel_12, FragmentB=merge_8)
merge_9 = Merge(Data1="Slicer Data //", Data2=concatenate_2, Data3=log_file, Data4=concatenate_4)  # -> flatten(Result)
list_length_2 = ListLength(List=merge_9)
series = Series(Start=0, Step="6", Count=list_length_2)
unit_z_4 = UnitZ(Factor=series)
negative_3 = Negative(Value=unit_z_4)
panel_13 = Panel(merge_9)
move_6 = Move(Geometry=xz_plane_2, Motion=negative_3)  # -> Geometry, Transform
text_tag_3d_2 = TextTag3D(Location=move_6.Geometry, Text=merge_9, Size="3", Colour=datablue, Justification=1)

# ---- group: OBJECT DIMENSIONS
bbox_3 = BoundingBox(Content=flatten(move.Geometry), Plane=PlaneXY(0, 0, 0), UnionBox=True)  # -> Box, Box_2
volume_2 = Volume(Geometry=bbox_3.Box)  # -> Volume, Centroid; disabled
project_2 = Project(Geometry=volume_2.Centroid, Plane=PlaneXY(0, 0, 0))  # -> Geometry, Transform; disabled
panel_14 = Panel("""0
3
11""")
unit_x_2 = UnitX(Factor="15")
unit_z_5 = UnitZ(Factor="15")
unit_y = UnitY(Factor="15")
scale_2 = Scale(Geometry=bbox_3.Box, Center=project_2.Geometry, Factor="1")  # -> Geometry, Transform; disabled
brep_edges_4 = BrepEdges(Brep=scale_2.Geometry)  # -> Naked, Interior, NonManifold; disabled
negative_4 = Negative(Value=unit_x_2)
negative_5 = Negative(Value=unit_y)
addition = Addition(A=negative_4, B=unit_z_5)
addition_2 = Addition(A=addition, B=unit_y)
panel_15 = Panel("2")  # disabled
panel_16 = Panel("""mm
mm
mm""")
preset_material_5 = PresetMaterial(Color=datablue, MaterialIndex="100")

# ----
brep_edges_5 = BrepEdges(Brep=bbox_3.Box)  # -> Naked, Interior, NonManifold

# ---- group: OBJECT DIMENSIONS (continued)
list_item_8 = ListItem(List=brep_edges_5.Interior, Index=panel_14, Wrap=True)
length_3 = Length(Curve=list_item_8)  # disabled
division_3 = Division(A=length_3, B="1.5")  # disabled
move_7 = Move(Geometry=list_item_8, Motion=[negative_5, negative_4, addition_2])  # -> Geometry, Transform
subtraction_2 = Subtraction(A=length_3, B=division_3)  # disabled
division_4 = Division(A=subtraction_2, B=panel_15)  # disabled
negative_6 = Negative(Value=division_4)  # disabled
extend_curve_2 = ExtendCurve(Curve=list_item_8, Type=0, Start=negative_6, End=negative_6)  # disabled
list_item_9 = ListItem(List=move_7.Geometry, Index=0, Wrap=True)  # -> Item1, Item, Item1_2
end_points_3 = EndPoints(Curve=list_item_9.Item1)  # -> Start, End
deconstruct_2 = Deconstruct(Point=end_points_3.Start)  # -> XComponent, YComponent, ZComponent
negative_7 = Negative(Value=deconstruct_2.ZComponent)
unit_z_6 = UnitZ(Factor=negative_7)
move_8 = Move(Geometry=list_item_9.Item1, Motion=unit_z_6)  # -> Geometry, Transform
merge_10 = Merge(Data1=list_item_9.Item, Data2=list_item_9.Item1_2, Data3=move_8.Geometry)
length_4 = Length(Curve=merge_10)
evaluate_curve_2 = EvaluateCurve(Curve=reparameterize(graft(merge_10)), Parameter="0.5")  # -> Point, Tangent, Angle
perp_frames_2 = PerpFrames(Curve=merge_10, Count=10, Align=reverse("1"))  # -> Frames, Parameters
curve_middle_2 = CurveMiddle(Curve=merge_10)
deconstruct_plane_2 = DeconstructPlane(Plane=perp_frames_2.Frames)  # -> Origin, XAxis, YAxis, ZAxis
construct_plane_2 = ConstructPlane(Origin=evaluate_curve_2.Point, XAxis=evaluate_curve_2.Tangent, YAxis=expr("-x", deconstruct_plane_2.YAxis))
list_item_10 = ListItem(List=construct_plane_2, Index=0, Wrap=True)  # -> flatten(Item)
dispatch_2 = Dispatch(List=list_item_10, DispatchPattern=[True, True, False])  # -> ListA, ListB
list_item_11 = ListItem(List=curve_middle_2, Index=-1, Wrap=True)
panel_17 = Panel(construct_plane_2)
rotate_3 = Rotate(Geometry=dispatch_2.ListB, Angle=degrees(-90), Plane=list_item_11)  # -> Geometry, Transform
xz_plane_3 = XZPlane(Origin=rotate_3.Geometry)
rotate_4 = Rotate(Geometry=rotate_3.Geometry, Angle=degrees("180"), Plane=xz_plane_3)  # -> Geometry, Transform
shapediver_display_5 = ShapeDiverDisplay(Geometry=merge_10, ShapeDiverMaterial=preset_material_5)

# ----
round_4 = Round(Number=length_4)  # -> Nearest, Floor, Ceiling

# ---- group: OBJECT DIMENSIONS (continued)
concatenate_5 = Concatenate(FragmentA=round_4.Nearest, FragmentB=panel_16)
text_tag_3d_3 = TextTag3D(Location=flatten([dispatch_2.ListA, rotate_4.Geometry]), Text=concatenate_5, Size="3", Colour=datablue, Justification=8)

# ==== cluster MambaFullSlicer: Simple Vase Slicer with base creator. It will automatically create base layers and severals walls if selected, spiral slicing only works with one wall V7.6
base_infill_line_distance = ClusterInput()
noozle_diameter = ClusterInput()
spiralize = ClusterInput()
slicing_distance = ClusterInput()
create_base = ClusterInput()
base_infill_wall_offset = ClusterInput()
adjust_seam_position = ClusterInput()
geometry = ClusterInput()  # ONLY CLEAN GEOMETRIES SINGLE
number_of_base_layers = ClusterInput()
number_of_walls = ClusterInput()
create_base_2 = Boolean(create_base)
noozle_diameter_2 = Number(noozle_diameter)
slicing_distance_2 = Number(slicing_distance)
base_infill_line_distance_2 = Number(base_infill_line_distance)
base_infill_wall_offset_2 = Number(base_infill_wall_offset)
number_of_walls_2 = Number(number_of_walls)
smaller_than = SmallerThan(FirstNumber=number_of_walls, SecondNumber="1")  # -> SmallerThan, OrEqualTo
stream_filter = StreamFilter(Gate=smaller_than.OrEqualTo, Stream0="0", Stream1=spiralize)
curve_to_polyline_tolerance_resolution = Slider(0.05, range=0..0.1)
number_of_base_layers_2 = Number(number_of_base_layers)
adjust_seam_position_2 = Number(adjust_seam_position)
null_item = NullItem(Item=slicing_distance_2)  # -> NullFlags, InvalidFlags, Description
spiralize_2 = Boolean(stream_filter)
null_item_2 = NullItem(Item=noozle_diameter_2)  # -> NullFlags, InvalidFlags, Description
null_item_3 = NullItem(Item=create_base_2)  # -> NullFlags, InvalidFlags, Description
null_item_4 = NullItem(Item=base_infill_line_distance_2)  # -> NullFlags, InvalidFlags, Description
null_item_5 = NullItem(Item=spiralize_2)  # -> NullFlags, InvalidFlags, Description
null_item_6 = NullItem(Item=number_of_base_layers_2)  # -> NullFlags, InvalidFlags, Description
null_item_7 = NullItem(Item=adjust_seam_position_2)  # -> NullFlags, InvalidFlags, Description
null_item_8 = NullItem(Item=base_infill_wall_offset_2)  # -> NullFlags, InvalidFlags, Description
null_item_9 = NullItem(Item=number_of_walls_2)  # -> NullFlags, InvalidFlags, Description
stream_filter_2 = StreamFilter(Gate=null_item.NullFlags, Stream0=slicing_distance_2, Stream1="2")
stream_filter_3 = StreamFilter(Gate=null_item_2.NullFlags, Stream0=noozle_diameter_2, Stream1="2")
multiplication = Multiplication(A=stream_filter_3, B="0.8")
multiplication_2 = Multiplication(A=stream_filter_3, B="0.7")
stream_filter_4 = StreamFilter(Gate=null_item_3.NullFlags, Stream0=create_base_2, Stream1="0")
max_line_lenght = Data(Slider(5, range=0..10))
stream_filter_5 = StreamFilter(Gate=null_item_5.NullFlags, Stream0=spiralize_2, Stream1="0")
min_line_lenght = Data(Slider(1, range=0..1))
stream_filter_6 = StreamFilter(Gate=null_item_4.NullFlags, Stream0=base_infill_line_distance_2, Stream1=multiplication)
stream_filter_7 = StreamFilter(Gate=null_item_6.NullFlags, Stream0=number_of_base_layers_2, Stream1="3")
stream_filter_8 = StreamFilter(Gate=null_item_8.NullFlags, Stream0=base_infill_wall_offset_2, Stream1=multiplication_2)
stream_filter_9 = StreamFilter(Gate=null_item_7.NullFlags, Stream0=adjust_seam_position_2, Stream1="0")
stream_filter_10 = StreamFilter(Gate=null_item_9.NullFlags, Stream0=number_of_walls_2, Stream1="1")
noozle_diameter_3 = Data(stream_filter_3)
create_base_3 = Data(stream_filter_4)
base_infill_wall_offset_3 = Data(stream_filter_8)
base_infill_line_distance_3 = Data(stream_filter_6)
number_of_walls_3 = Data(stream_filter_10)
number_of_base_layers_3 = Data(stream_filter_7)
spiralize_3 = Data(stream_filter_5)
adjust_seam_position_3 = Data(stream_filter_9)
geometry_2 = Geometry(geometry)
noozle_diameter_4 = Number(noozle_diameter_3)
tolerance_resolution = Number(curve_to_polyline_tolerance_resolution)
slicing_distance_3 = Number(stream_filter_2)
create_base_4 = Boolean(create_base_3)
min_line_lenght_2 = Number(min_line_lenght)
max_line_lenght_2 = Number(max_line_lenght)
merge = Merge(Data1=tolerance_resolution, Data2=min_line_lenght_2, Data3=max_line_lenght_2)
number_of_base_layers_4 = Data(number_of_base_layers_3)
min_line_lenght_3 = Data(min_line_lenght_2)
base_infill_wall_offset_4 = Data(base_infill_wall_offset_3)
base_infill_line_distance_4 = Data(base_infill_line_distance_3)
max_line_lenght_3 = Data(max_line_lenght_2)
create_base_5 = Boolean(create_base_4)
colour_swatch = ColourSwatch(SwatchColor=RGB(184, 184, 184))
preset_material = PresetMaterial(Color=colour_swatch, MaterialIndex="100")
number_of_walls_4 = Data(number_of_walls_3)
number_of_walls_5 = Data(number_of_walls_3)
spiralize_4 = Data(spiralize_3)
equality = Equality(FirstNumber="1", SecondNumber=number_of_walls_4)  # -> Equality, Inequality
mass_multiplication = MassMultiplication(Input=[spiralize_4, number_of_walls_5])  # -> Result, PartialResults
mass_addition = MassAddition(Input=[spiralize_4, number_of_walls_5])  # -> Result, PartialResults
smaller_than_2 = SmallerThan(FirstNumber=mass_multiplication.Result, SecondNumber="1")  # -> SmallerThan, OrEqualTo
settings_flow = Data(smaller_than_2.OrEqualTo)
stream_filter_11 = StreamFilter(Gate=smaller_than_2.OrEqualTo, Stream0="You can´t spiralize with more than one wall!", Stream1="All good to go")
settings_flow_2 = Data(stream_filter_11)
messages = ClusterOutput(settings_flow_2)
subtraction = Subtraction(A=number_of_walls_4, B="1")
equality_2 = Equality(FirstNumber="1", SecondNumber=subtraction)  # -> Equality, Inequality
boolean_toggle = BooleanToggle(True)

unit_z = UnitZ(Factor=slicing_distance_3)
move = Move(Geometry=geometry_2, Motion=unit_z)  # -> Geometry, Transform
bounding_box = BoundingBox(Content=move.Geometry, Plane=PlaneXY(0, 0, 0), UnionBox=True)  # -> Box, Box_2
deconstruct_box = DeconstructBox(Box=bounding_box.Box)  # -> Plane, X, Y, Z
deconstruct_domain = DeconstructDomain(Domain=deconstruct_box.Z)  # -> Start, End
geometry_input = Geometry(move.Geometry)
# Contouring
list_length = ListLength(List=flatten(geometry_input))
construct_point = ConstructPoint(XCoordinate=0, YCoordinate=0, ZCoordinate=deconstruct_domain.Start)
contour = Contour(Shape=geometry_input, Point=construct_point, Direction=Vector(0, 0, 1), Distance=slicing_distance_3)
equality_3 = Equality(FirstNumber=list_length, SecondNumber="1")  # -> Equality, Inequality

join_curves = JoinCurves(Curves=contour, Preserve=False)

simplify_tree = SimplifyTree(Tree=join_curves, Front=False)
tree_statistics = TreeStatistics(Tree=simplify_tree)  # -> Paths, Length, Count
trim_tree = TrimTree(Tree=simplify_tree, Depth="1")
mass_multiplication_2 = MassMultiplication(Input=tree_statistics.Length)  # -> Result, PartialResults
stream_filter_12 = StreamFilter(Gate=equality_3.Inequality, Stream0=simplify_tree, Stream1=trim_tree)
gate_and = GateAnd(A=mass_multiplication_2.Result, B=equality_3.Equality)
flatten_tree = FlattenTree(Tree=stream_filter_12, Path="{0}")
stream_filter_13 = StreamFilter(Gate=gate_and, Stream0=stream_filter_12, Stream1=flatten_tree)

list_item = ListItem(List=tree_statistics.Length, Index=0, Wrap=True)
merge_2 = Merge(Data1=equality_3.Inequality, Data2=slicing_distance_3, Data3=noozle_diameter_4, Data4=merge)
sliced_geometry = Curve(stream_filter_13)
curve_to_polyline = CurveToPolyline(
    Curve=sliced_geometry,
    ToleranceDistance=tolerance_resolution,
    ToleranceAngle=0,
    MinEdge=min_line_lenght_2,
    MaxEdge=max_line_lenght_2)  # -> Polyline, Segments
geometry_3 = Geometry(curve_to_polyline.Polyline)
stream_gate = StreamGate(Stream=geometry_3, Gate=create_base_5)  # -> Target0, Target1
settings_flow_3 = Data(merge_2)
settings_flow_4 = ClusterOutput(settings_flow_3)

# ---- group: BASE CREATOR
curve = Curve(stream_gate.Target1)
tree_statistics_2 = TreeStatistics(Tree=curve)  # -> Paths, Length, Count
equality_4 = Equality(FirstNumber=tree_statistics_2.Count, SecondNumber="1")  # -> Equality, Inequality
number_of_base_layers_5 = Data(number_of_base_layers_4)
tree_statistics_3 = TreeStatistics(Tree=curve)  # -> Paths, Length, Count
param_viewer = ParamViewer(curve)
stream_gate_2 = StreamGate(Stream=curve, Gate=equality_4.Equality)  # -> Target0, Target1
split_list = SplitList(List=tree_statistics_3.Paths, Index=number_of_base_layers_5)  # -> ListA, ListB
split_tree = SplitTree(Data=curve, Masks=flatten(split_list.ListA))  # -> simplify(Positive), Negative
data = Data(min_line_lenght_3)
data_2 = Data(max_line_lenght_3)
boolean_toggle_2 = BooleanToggle(True)
offset_between_same_layer_curves_to_inte = Data(base_infill_wall_offset_4)  # "OFFSET BETWEEN SAME LAYER CURVES TO INTERNAL INFIL"
number_of_base_layers_6 = Number(number_of_base_layers_5)
Y = UnitY(Factor=1)
X = UnitX(Factor=1)
merge_3 = Merge(Data1=Y, Data2=X)
repeat_data = RepeatData(Data=merge_3, Length=number_of_base_layers_6)
base_infill_line_distance_5 = Data(base_infill_line_distance_4)
number_slider = Slider(1, range=0..1)

# ----
equality_5 = Equality(FirstNumber=mass_multiplication_2.Result, SecondNumber="1")  # -> Equality, Inequality
split_list_2 = SplitList(List=tree_statistics.Length, Index=number_of_base_layers_4)  # -> ListA, ListB
# One single geometry multiples bases
mass_addition_2 = MassAddition(Input=split_list_2.ListA)  # -> Result, PartialResults
stream_filter_14 = StreamFilter(Gate=equality_5.Inequality, Stream0=number_of_base_layers_5, Stream1=mass_addition_2.Result)

equality_6 = Equality(FirstNumber=number_of_base_layers_6, SecondNumber="1")  # -> Equality, Inequality

# ---- group: BASE CREATOR (continued)
split_list_3 = SplitList(List=stream_gate_2.Target1, Index=stream_filter_14)  # -> ListA, ListB
stream_filter_15 = StreamFilter(Gate=equality_4.Equality, Stream0=split_tree.Positive, Stream1=split_list_3.ListA)
curve_to_polyline_2 = CurveToPolyline(Curve=stream_filter_15, ToleranceDistance=tolerance_resolution, ToleranceAngle=0, MinEdge=data, MaxEdge=data_2)  # -> Polyline, Segments
stream_filter_16 = StreamFilter(Gate=equality_4.Equality, Stream0=split_tree.Negative, Stream1=split_list_3.ListB)
discontinuity = Discontinuity(Curve=curve_to_polyline_2.Polyline, Level=1)  # -> Points, Parameters
interpolate = Interpolate(Vertices=discontinuity.Points, Degree=3, Periodic=boolean_toggle_2, KnotStyle=1)  # -> Curve, Length, Domain; disabled

# ----
rest_of_layers_after_base = Curve(stream_filter_16)
rest_of_layers_after_base_2 = Curve(rest_of_layers_after_base)
merge_4 = Merge(Data1=rest_of_layers_after_base_2, Data2=stream_gate.Target0)
polyline = PolyLine(Vertices=discontinuity.Points, Closed=boolean_toggle_2)
list_length_2 = ListLength(List=curve_to_polyline_2.Polyline)
equality_7 = Equality(FirstNumber=list_length_2, SecondNumber="1")  # -> Equality, Inequality
gate_and_2 = GateAnd(A=equality_6.Equality, B=equality_7.Equality)
panel = Panel(gate_and_2)

curve_2 = Curve(merge_4)
length = Length(Curve=curve_2)
average = Average(Input=length)
shift_list = ShiftList(List=curve_2, Shift=1, Wrap=invert(True))
adjust_seam_position_4 = Number(adjust_seam_position_3)
stream_gate_3 = StreamGate(Stream=curve_2, Gate=spiralize_3)  # -> Target0, Target1
list_item_2 = ListItem(List=curve_2, Index=0, Wrap=True)
evaluate_curve = EvaluateCurve(Curve=reparameterize(stream_gate_3.Target0), Parameter=adjust_seam_position_3)  # -> Point, Tangent, Angle
evaluate_curve_2 = EvaluateCurve(Curve=reparameterize(list_item_2), Parameter=adjust_seam_position_4)  # -> Point, Tangent, Angle

# ----
# SEAM ALIGNER
multiplication_3 = Multiplication(A=Slider(5, range=0..10), B=average)

divide_curve = DivideCurve(Curve=curve_2, Count=multiplication_3, Kinks=False)  # -> Points, Tangents, Parameters

interpolate_2 = Interpolate(Vertices=divide_curve.Points, Degree=3, Periodic=invert(False), KnotStyle=1)  # -> Curve, Length, Domain
trim_tree_2 = TrimTree(Tree=interpolate_2.Curve, Depth=1)
divide_curve_2 = DivideCurve(Curve=interpolate_2.Curve, Count=multiplication_3, Kinks=False)  # -> Points, Tangents, Parameters

closest_point = ClosestPoint(Point=evaluate_curve_2.Point, Cloud=divide_curve_2.Points)  # -> ClosestPoint, CPIndex, Distance
curve_closest_point = CurveClosestPoint(Point=flatten(closest_point.ClosestPoint), Curve=trim_tree_2)  # -> Point, Parameter, Distance
seam = Seam(Curve=trim_tree_2, Seam=curve_closest_point.Parameter)

stream_gate_4 = StreamGate(Stream=seam, Gate=spiralize_3)  # -> Target0, Target1
end_points = EndPoints(Curve=seam)  # -> Start, End
stream_filter_17 = StreamFilter(Gate=spiralize_3, Stream0=evaluate_curve.Point, Stream1=end_points.Start)
shapediver_display = ShapeDiverDisplay(Geometry=stream_filter_17, ShapeDiverMaterial=preset_material)
custom_preview = CustomPreview(Geometry=stream_filter_17, Material=colour_swatch)
stream_gate_5 = StreamGate(Stream=stream_gate_4.Target1, Gate=settings_flow)  # -> Target0, Target1

# ---- group: BASE CREATOR (continued)
bounding_box_2 = BoundingBox(Content=polyline, Plane=PlaneXY(0, 0, 0))  # -> Box, Box_2
volume = Volume(Geometry=bounding_box_2.Box)  # -> Volume, Centroid
python = GhPythonScript(crv=simplify(polyline), dir=simplify(volume.Centroid), dis=offset_between_same_layer_curves_to_inte)  # -> out, a
# ---------- python: Python ----------
__author__ = "jhorikawa"

import rhinoscriptsyntax as rs

a = rs.OffsetCurve(crv,dir,dis)
# ---------- end python ----------
original_layers_without_offset = Curve(polyline)

# ----
bounding_box_3 = BoundingBox(Content=python.a, Plane=PlaneXY(0, 0, 0))  # -> Box, Box_2
deconstruct = Deconstruct(Point=volume.Centroid)  # -> XComponent, YComponent, ZComponent
volume_2 = Volume(Geometry=bounding_box_3.Box)  # -> Volume, Centroid
deconstruct_2 = Deconstruct(Point=volume_2.Centroid)  # -> XComponent, YComponent, ZComponent
construct_point_2 = ConstructPoint(XCoordinate=0, YCoordinate=0, ZCoordinate=deconstruct.ZComponent)
construct_point_3 = ConstructPoint(XCoordinate=0, YCoordinate=0, ZCoordinate=deconstruct_2.ZComponent)
# BASE CREATOR
match_tree = MatchTree(Tree=construct_point_3, Guide=construct_point_2)
vector_2pt = Vector2Pt(PointA=match_tree, PointB=construct_point_2, Unitize=False)  # -> Vector, Length
move_2 = Move(Geometry=simplify(python.a), Motion=simplify(vector_2pt.Vector))  # -> Geometry, Transform

curve_3 = Curve(stream_gate_5.Target1)
list_item_3 = ListItem(List=curve_3, Index=0, Wrap=True)
flip_curve = FlipCurve(Curve=curve_3, Guide=list_item_3)  # -> Curve, Flag
length_2 = Length(Curve=flip_curve.Curve)
average_2 = Average(Input=length_2)
divide_curve_3 = DivideCurve(Curve=flip_curve.Curve, Count=average_2, Kinks=False)  # -> Points, Tangents, Parameters
number_slider_2 = Slider(15, range=0..50)
list_length_3 = ListLength(List=divide_curve_3.Points)
series = Series(Start=0, Step=1, Count=list_length_3)  # -> reverse(Series)
slicing_distance_4 = Number(slicing_distance_3)
number_slider_3 = Slider(10, range=0..10)
split_list_4 = SplitList(List=series, Index=number_slider_2)  # -> ListA, ListB
match_tree_2 = MatchTree(Tree=split_list_4.ListA, Guide=divide_curve_3.Points)
panel_2 = Panel(split_list_4.ListA)
division = Division(A=slicing_distance_4, B=number_slider_2)
series_2 = Series(Start=division, Step=division, Count=number_slider_2)  # -> reverse(Series)
list_item_4 = ListItem(List=divide_curve_3.Points, Index=match_tree_2, Wrap=invert(True))
relative_item = RelativeItem(Tree=simplify(list_item_4), Offset="{1}", WrapPaths=False, WrapItems=False)  # -> ItemA, ItemB
vector_2pt_2 = Vector2Pt(PointA=relative_item.ItemA, PointB=relative_item.ItemB, Unitize=invert(False))  # -> Vector, Length
multiplication_4 = Multiplication(A=series_2, B=vector_2pt_2.Vector)
move_3 = Move(Geometry=list_item_4, Motion=multiplication_4)  # -> Geometry, Transform
panel_3 = Panel(series_2)
replace_items = ReplaceItems(List=divide_curve_3.Points, Item=move_3.Geometry, Indices=split_list_4.ListA, Wrap=False)

# ---- group: Extend first layer init to fill slide
division_2 = Division(A=number_slider_2, B="2")
series_3 = Series(Start="1", Step=1, Count=division_2)  # -> reverse(Series)
# SPIRALIZER
tree_statistics_4 = TreeStatistics(Tree=divide_curve_3.Points)  # -> Paths, Length, Count
list_item_5 = ListItem(List=tree_statistics_4.Paths, Index=0, Wrap=True)
negative = Negative(Value=series_3)
list_item_6 = ListItem(List=divide_curve_3.Points, Index=negative, Wrap=Toggle(True))
tree_item = TreeItem(Tree=list_item_6, Path=list_item_5, Index=negative, Wrap=True)

# ----
merge_5 = Merge(Data1=flatten(tree_item), Data2=flatten(replace_items))
interpolate_3 = Interpolate(Vertices=flatten(merge_5), Degree=3, Periodic=False, KnotStyle=1)  # -> Curve, Length, Domain
number = Number(division_2)
negative_2 = Negative(Value=number)

extend_curve = ExtendCurve(Curve=interpolate_3.Curve, Type=0, Start="0", End=negative_2)
curve_4 = Curve(extend_curve)
stream_filter_18 = StreamFilter(Gate=settings_flow, Stream0=stream_gate_5.Target0, Stream1=curve_4)
stream_filter_19 = StreamFilter(Gate=spiralize_3, Stream0=stream_gate_4.Target0, Stream1=stream_filter_18)
stream_gate_6 = StreamGate(Stream=stream_filter_19, Gate=equality.Equality)  # -> Target0, Target1

# ---- group: BASE CREATOR (continued)
bounding_box_4 = BoundingBox(Content=move_2.Geometry, Plane=PlaneXY(0, 0, 0))  # -> Box, Box_2
volume_3 = Volume(Geometry=bounding_box_4.Box)  # -> Volume, Centroid
project = Project(Geometry=move_2.Geometry, Plane=volume_3.Centroid)  # -> Geometry, Transform
simplify_tree_2 = SimplifyTree(Tree=project.Geometry, Front=False)
partition_list = PartitionList(List=simplify_tree_2, Size="1")
trim_tree_3 = TrimTree(Tree=simplify(partition_list), Depth="1")

# ----
partition_list_2 = PartitionList(List=flatten(simplify_tree_2), Size=list_item)
stream_filter_20 = StreamFilter(Gate=equality_5.Inequality, Stream0=partition_list, Stream1=partition_list_2)

# ---- group: BASE CREATOR (continued)
stream_filter_21 = StreamFilter(Gate=equality_4.Equality, Stream0=trim_tree_3, Stream1=stream_filter_20)
match_tree_3 = MatchTree(Tree=graft(repeat_data), Guide=stream_filter_21)
contour_2 = Contour(Shape=stream_filter_21, Point=Point(0, 0, 0), Direction=match_tree_3, Distance=base_infill_line_distance_5)

# ----
contour_3 = Contour(Curve=stream_filter_21, Point=Point(0, 0, 0), Direction=match_tree_3, Distance=base_infill_line_distance_5)  # -> Contours, Parameters
contour_4 = Contour(Shape=stream_filter_21, Point=Point(0, 0, 0), Direction=match_tree_3, Distance=base_infill_line_distance_5)  # disabled
polyline_2 = PolyLine(Vertices=contour_3.Contours, Closed=False)

# ---- group: BASE CREATOR (continued)
simplify_tree_3 = SimplifyTree(Tree=polyline_2, Front=False)

# ----
trim_tree_4 = TrimTree(Tree=simplify_tree_3, Depth=number_slider)
flatten_tree_2 = FlattenTree(Tree=simplify_tree_3, Path="{0}")
stream_filter_22 = StreamFilter(Gate=gate_and_2, Stream0=trim_tree_4, Stream1=flatten_tree_2)
list_item_7 = ListItem(List=stream_filter_22, Index=0, Wrap=True)
flip_curve_2 = FlipCurve(Curve=stream_filter_22, Guide=list_item_7)  # -> Curve, Flag

# ---- group: BASE CREATOR (continued)
dispatch = Dispatch(List=flip_curve_2.Curve, DispatchPattern=[True, False])  # -> ListA, ListB
flip = FlipCurve(Curve=dispatch.ListA)  # -> Curve, Flag
weave = Weave(Pattern=[0, 1], Stream0=flip.Curve, Stream1=dispatch.ListB, NullGaps=False)
connect = ConnectCurves(Curves=weave, Continuity=0, Close=invert(True), Bulge=1)
match_tree_4 = MatchTree(Tree=original_layers_without_offset, Guide=connect)
merge_6 = Merge(Data1=match_tree_4, Data2=connect)

# ----
curve_5 = Curve(stream_gate_6.Target0)
length_3 = Length(Curve=curve_5)
division_3 = Division(A=length_3, B=Slider(3, range=0..10))
divide_curve_4 = DivideCurve(Curve=curve_5, Count=division_3, Kinks=False)  # -> Points, Tangents, Parameters
interpolate_4 = Interpolate(Vertices=divide_curve_4.Points, Degree=3, Periodic=invert(False), KnotStyle=1)  # -> Curve, Length, Domain
# WALLS
geometry_4 = Geometry(interpolate_4.Curve)
bounding_box_5 = BoundingBox(Content=geometry_4, Plane=PlaneXY(0, 0, 0))  # -> Box, Box_2
volume_4 = Volume(Geometry=bounding_box_5.Box)  # -> Volume, Centroid
noozle_diameter_5 = Number(noozle_diameter_3)
series_4 = Series(Start=noozle_diameter_5, Step=noozle_diameter_5, Count=subtraction)
python_2 = GhPythonScript(crv=simplify(flatten(geometry_4)), dir=simplify(flatten(volume_4.Centroid)), dis=graft(series_4))  # -> out, a; same code as python
simplify_tree_4 = SimplifyTree(Tree=python_2.a, Front=False)
repeat_data_2 = RepeatData(Data="1", Length=subtraction)
trim_tree_5 = TrimTree(Tree=simplify_tree_4, Depth=1)
merge_7 = Merge(Data1="0", Data2=repeat_data_2)  # -> flatten(Result)
flip_matrix = FlipMatrix(Data=trim_tree_5)

stream_filter_23 = StreamFilter(Gate=equality_2.Equality, Stream0=flip_matrix, Stream1=simplify_tree_4)

weave_2 = Weave(Pattern=merge_7, Stream0=curve_5, Stream1=flatten(stream_filter_23), NullGaps=False)

stream_filter_24 = StreamFilter(Gate=equality.Equality, Stream0=weave_2, Stream1=stream_gate_6.Target1)
entwine = Entwine(Branch00=merge_6, Branch01=stream_filter_24, FlattenInputs=True)

# ---- group: ADD A BRIM LAYER
first_sliced_curve = Geometry(join_curves)
list_item_8 = ListItem(List=flatten(entwine), Index=0, Wrap=True)
list_item_9 = ListItem(List=flatten(first_sliced_curve), Index=0, Wrap=True)
offset_curve = OffsetCurve(Curve=list_item_9, Distance="10", Corners=1)
length_4 = Length(Curve=offset_curve)
evaluate_curve_3 = EvaluateCurve(Curve=reparameterize(list_item_8), Parameter="0")  # -> Point, Tangent, Angle
divide_curve_5 = DivideCurve(Curve=offset_curve, Count=length_4, Kinks=False)  # -> Points, Tangents, Parameters
closest_point_2 = ClosestPoint(Point=evaluate_curve_3.Point, Cloud=divide_curve_5.Points)  # -> ClosestPoint, CPIndex, Distance
curve_closest_point_2 = CurveClosestPoint(Point=flatten(closest_point_2.ClosestPoint), Curve=offset_curve)  # -> Point, Parameter, Distance
seam_2 = Seam(Curve=offset_curve, Seam=curve_closest_point_2.Parameter)

# ----
merge_8 = Merge(Data1=seam_2, Data2=entwine)
clean_tree = CleanTree(RemoveNulls=boolean_toggle, RemoveInvalid=boolean_toggle, RemoveEmpty=boolean_toggle, Tree=merge_8)
curve_to_polyline_3 = CurveToPolyline(
    Curve=clean_tree,
    ToleranceDistance=tolerance_resolution,
    ToleranceAngle=0,
    MinEdge=min_line_lenght_2,
    MaxEdge=max_line_lenght_2)  # -> flatten(Polyline), Segments
polyline_3 = ClusterOutput(curve_to_polyline_3.Polyline)

# ==== cluster Cluster
extrusion_wait_time = Panel("500")
retraction_amount = Panel("1")
pressure_control = Panel("0")
z_hop_height = Panel("5")
extruding_amount_e = ClusterInput()
jog_speed_f_mm_s = ClusterInput()
z_base_offset = ClusterInput()
print_speed_f_mm_s = ClusterInput()
start_endgcode = ClusterInput()
sliced_geometry = ClusterInput()
settings_flow = ClusterInput()

retraction_amount_2 = Number(retraction_amount)
extruding_amount_e_2 = Number(extruding_amount_e)
jog_speed_f_mm_s_2 = Number(jog_speed_f_mm_s)
z_base_offset_2 = Number(z_base_offset)
print_speed_f_mm_s_2 = Number(print_speed_f_mm_s)
z_hop_height_2 = Data(z_hop_height)
pressure_control_2 = Boolean(pressure_control)
extrusion_wait_time_2 = Data(extrusion_wait_time)
start_endgcode_2 = Data(start_endgcode)
null_item = NullItem(Item=z_hop_height_2)  # -> NullFlags, InvalidFlags, Description
sliced_geometry_2 = Geometry(sliced_geometry)
null_item_2 = NullItem(Item=z_base_offset_2)  # -> NullFlags, InvalidFlags, Description
settings_flow_2 = Data(settings_flow)
null_item_3 = NullItem(Item=jog_speed_f_mm_s_2)  # -> NullFlags, InvalidFlags, Description
null_item_4 = NullItem(Item=print_speed_f_mm_s_2)  # -> NullFlags, InvalidFlags, Description
null_item_5 = NullItem(Item=extruding_amount_e_2)  # -> NullFlags, InvalidFlags, Description
null_item_6 = NullItem(Item=pressure_control_2)  # -> NullFlags, InvalidFlags, Description
null_item_7 = NullItem(Item=retraction_amount_2)  # -> NullFlags, InvalidFlags, Description
null_item_8 = NullItem(Item=extrusion_wait_time_2)  # -> NullFlags, InvalidFlags, Description
stream_filter = StreamFilter(Gate=null_item.NullFlags, Stream0=z_hop_height_2, Stream1="0")
stream_filter_2 = StreamFilter(Gate=null_item_2.NullFlags, Stream0=z_base_offset_2, Stream1="0")
stream_filter_3 = StreamFilter(Gate=null_item_4.NullFlags, Stream0=print_speed_f_mm_s_2, Stream1="500")
stream_filter_4 = StreamFilter(Gate=null_item_3.NullFlags, Stream0=jog_speed_f_mm_s_2, Stream1="2000")
stream_filter_5 = StreamFilter(Gate=null_item_6.NullFlags, Stream0=pressure_control_2, Stream1="0")
stream_filter_6 = StreamFilter(Gate=null_item_5.NullFlags, Stream0=extruding_amount_e_2, Stream1="5")
stream_filter_7 = StreamFilter(Gate=null_item_7.NullFlags, Stream0=retraction_amount_2, Stream1="0.5")
stream_filter_8 = StreamFilter(Gate=null_item_8.NullFlags, Stream0=extrusion_wait_time_2, Stream1="250")
z_base_offset_3 = Number(stream_filter_2)
z_hop_height_3 = Data(stream_filter)
print_speed_f_mm_s_3 = Number(stream_filter_3)
extruding_amount_e_3 = Number(stream_filter_6)
jog_speed_f_mm_s_3 = Number(stream_filter_4)
pressure_control_3 = Data(stream_filter_5)
extrusion_wait_time_3 = Data(stream_filter_8)
retraction_amount_3 = Number(stream_filter_7)
unit_z = UnitZ(Factor=z_base_offset_3)
list_item = ListItem(List=settings_flow_2, Index="3", Wrap=True)  # -> Item, Item1, Item2
panel = Panel(settings_flow_2)
curve_to_polyline = CurveToPolyline(
    Curve=sliced_geometry_2,
    ToleranceDistance=list_item.Item,
    ToleranceAngle=0,
    MinEdge=list_item.Item1,
    MaxEdge=list_item.Item2)  # -> Polyline, Segments
move = Move(Geometry=curve_to_polyline.Polyline, Motion=unit_z)  # -> Geometry, Transform
sliced_geometry_3 = Geometry(move.Geometry)
explode = Explode(SlicedGeometry=sliced_geometry_3, Recursive=True)  # -> Segments, Vertices
bang = ExplodeTree(Data=start_endgcode_2)  # -> flatten(Branch0), flatten(Branch1)
g_code_header = Text(bang.Branch0)
pt = Point(explode.Vertices)
g_code_footer = Text(bang.Branch1)
prune = PruneTree(Tree=pt, Minimum="1", Maximum=0)
panel_2 = Panel(pt)
simplify = SimplifyTree(Tree=prune, Front=False)
trim = TrimTree(Tree=simplify, Depth=1)
tstat = TreeStatistics(Tree=simplify)  # -> Paths, Length, Count
series = Series(Start="1", Step=1, Count=tstat.Count)  # -> graft(Series)
panel_3 = Panel(series)
match = MatchTree(Tree=series, Guide=trim)
graft = GraftTree(Tree=match, IncludeEmptyLists=True, IncludeNullItems=True)
panel_4 = Panel("""-1
-2
-3""")
Z = UnitZ(Factor=z_hop_height_3)
int = Integer(series)
panel_5 = Panel("""200
500
500
200""")
filter = StreamFilter(Gate=pressure_control_3, Stream0=jog_speed_f_mm_s_3, Stream1=panel_5)
expression = Expression(n=int, Expression="Format(\";Layer # {0}\", n)")
panel_6 = Panel(expression)

# ---- group: E value calculation
shift = ShiftList(List=simplify, Shift=1, Wrap="1")
dist = Distance(PointA=simplify, PointB=shift)
cull_i = CullIndex(List=dist, Indices="-1", Wrap=True)
expression_2 = Expression(x=cull_i, y=extruding_amount_e_3, Expression="x*y")
ma = MassAddition(Input=flatten(expression_2))  # -> Result, PartialResults
lng = ListLength(List=expression_2)  # -> flatten(Length)
partition = PartitionList(List=ma.PartialResults, Size=lng)

# ----
cull_i_2 = CullIndex(List=simplify, Indices="0", Wrap=True)  # -> simplify(List)
item = ListItem(List=simplify, Index="0", Wrap=True)

# ---- group: statisitics
item_2 = ListItem(List=settings_flow_2, Index="2", Wrap=True)
noozle_diameter = Number(item_2)
item_3 = ListItem(List=settings_flow_2, Index="1", Wrap=True)
expression_3 = Expression(x=item_3, Expression="x/4")
len = Length(Curve=flatten(sliced_geometry_3))
ma_2 = MassAddition(Input=len)  # -> Result, PartialResults
rectangle = Rectangle(Plane=PlaneXY(0, 0, 0), XSize=item_3, YSize=noozle_diameter, Radius=expression_3)  # -> Rectangle, Length
expression_4 = Expression(x=ma_2.Result, y=print_speed_f_mm_s_3, Expression="(x/y)+(x/y)*0.25")
area = Area(Geometry=rectangle.Rectangle)  # -> Area, Centroid
expression_5 = Expression(x=ma_2.Result, y=area.Area, Expression="(x*y)/1000")

# ----
round = Round(Number=expression_4)  # -> Nearest, Floor, Ceiling
round_2 = Round(Number=ma_2.Result)  # -> Nearest, Floor, Ceiling
round_3 = Round(Number=expression_5)  # -> Nearest, Floor, Ceiling
match_2 = MatchTree(Tree=partition, Guide=simplify)
pt_2 = Point(cull_i_2)
num = Number(match_2)
pt_3 = Point(item)
item_4 = ListItem(List=pt_2, Index="-1", Wrap=True)
item_5 = ListItem(List=pt_2, Index="-3", Wrap=True)
item_6 = ListItem(List=pt_2, Index=panel_4, Wrap=True)
item_7 = ListItem(List=pt_2, Index="-1", Wrap=True)
filter_2 = StreamFilter(Gate=pressure_control_3, Stream0=item_4, Stream1=item_5)
filter_3 = StreamFilter(Gate=pressure_control_3, Stream0=item_7, Stream1=item_6)
move_2 = Move(Geometry=filter_2, Motion=Z)  # -> Geometry, Transform
move_3 = Move(Geometry=pt_3, Motion=Z)  # -> Geometry, Transform
expression_6 = Expression(
    P=pt_2,
    PrintSpeedF=print_speed_f_mm_s_3,
    Extrusion=num,
    Expression="Format(\"G1 X{0:0.00} Y{1:0.00} Z{2:0.00} F{3,0} E{4:0.00}\", P.x, P.y, P.z, PrintSpeedF, Extrusion)")
expression_7 = Expression(
    P=pt_2,
    PrintSpeedF=print_speed_f_mm_s_3,
    Expression="Format(\"G1 X{0:0.00} Y{1:0.00} Z{2:0.00} F{3,0}\", P.x, P.y, P.z, PrintSpeedF)")

# ---- group: statisitics (continued)
concat = Concatenate(FragmentA=round_2.Floor, FragmentB=" mm")
concat_2 = Concatenate(FragmentA=round.Floor, FragmentB=" minutes")
concat_3 = Concatenate(FragmentA=round_3.Floor, FragmentB="ml")

# ---- group: retraction calculation
item_8 = ListItem(List=match_2, Index="-1", Wrap=True)
tolerance_resolution = Number(retraction_amount_3)
expression_8 = Expression(x=item_8, y=tolerance_resolution, Expression="x-y")
flatten = FlattenTree(Tree=expression_8, Path="{0}")
ins = InsertItems(List=flatten, Item="0", Indices="0", Wrap=True)  # -> simplify(flatten(List))

# ---- group: saftey movements
merge = Merge(Data1=filter_3, Data2=move_2.Geometry)
merge_2 = Merge(Data1=move_3.Geometry, Data2=pt_3)

# ----
panel_7 = Panel("""M106 P0 S255
M107""")
filter_4 = StreamFilter(Gate=pressure_control_3, Stream0=expression_6, Stream1=expression_7)
panel_8 = Panel("""0
-1""")
ins_2 = InsertItems(List=filter_4, Item=panel_7, Indices=panel_8, Wrap=True)
concat_4 = Concatenate(FragmentA="G4 ", FragmentB="P", FragmentC=extrusion_wait_time_3)
panel_9 = Panel("""1
-1""")
ins_3 = InsertItems(List=ins_2, Item=concat_4, Indices=panel_9, Wrap=True)
panel_10 = Panel("""0
-3""")
ins_4 = InsertItems(List=ins_3, Item="M400", Indices=panel_10, Wrap=True)
trim_2 = TrimTree(Tree=ins_4, Depth="3")
filter_5 = StreamFilter(Gate=pressure_control_3, Stream0=filter_4, Stream1=trim_2)

graft_2 = GraftTree(Tree=ins, IncludeEmptyLists=True, IncludeNullItems=True)
expression_9 = Expression(
    P=merge_2,
    JogSpeedF=jog_speed_f_mm_s_3,
    Expression="Format(\"G0 X{0:0.00} Y{1:0.00} Z{2:0.00} F{3,0} \", P.x, P.y, P.z, JogSpeedF)")
expression_10 = Expression(P=merge, JogSpeedF=filter, Expression="Format(\"G0 X{0:0.00} Y{1:0.00} Z{2:0.00} F{3,0} \", P.x, P.y, P.z, JogSpeedF)")
total_print_lenght = Text(concat)
total_print_volume = Text(concat_3)
total_print_time = Text(concat_2)
panel_11 = Panel(total_print_lenght)
panel_12 = Panel(total_print_time)
panel_13 = Panel(total_print_volume)

# ---- group: retraction
expression_11 = Expression(
    PointsDataMatch=pt_3,
    PrintSpeedF=print_speed_f_mm_s_3,
    back=graft_2,
    Expression="Format(\"G1 F{0,0} E{1:0.00}\", PrintSpeedF, back)")

# ----
gate = StreamGate(Stream=expression_11, Gate=pressure_control_3)  # -> Target0, Target1
merge_3 = Merge(
    Data1=simplify(expression),
    Data2=simplify(gate.Target0),
    Data3=simplify(expression_9),
    Data4=simplify(filter_5),
    Data5=simplify(expression_10))
entwine = Entwine(Branch00=g_code_header, Branch01=merge_3, Branch02=g_code_footer, FlattenInputs=True)  # -> flatten(Result)
g_code_output = Text(entwine)
panel_14 = Panel(g_code_output)

g_code_output_2 = ClusterOutput(g_code_output)

# ==== cluster Cluster_2
list = ClusterInput()
list_item = ListItem(List=list, Index=0, Wrap=True)  # -> Item, Item1, Item2
A = ClusterInput()
multiplication = Multiplication(A=list_item.Item1, B=list_item.Item2)
division = Division(A=A, B="100")
multiplication_2 = Multiplication(A=multiplication, B=division)
result = ClusterOutput(multiplication_2)

# ==== cluster Cluster_3

# ---- group: Config for Paste Printing
header = Panel(""";HEADER
;Start_gcode
G21                     ; Set to metric [change to G20 if you want Imperial]
G91                     ; Force coordinates to be absolute relative to the origin
G1 Z10 F1000
G90                  ; Force coordinates to be absolute relative to the origin
G28 X                   ; Home X axis
G28 Y                   ; Home Y axis
G28 Z                     ; Home Z axis
M302 P1			; Disable Cold Extrusion Checking
G92 E0                  ; Reset extruder to [0] zero end of cleaning run
G91                     ; Force coordinates to be absolute relative to the origin
G1 Z10 F1000
G90
T0
M117 Printing...
;ENDHEADER""")
footer = Panel(""";FOOTER
; end_gcode
G91                             ; relative positioning
M107                            ; turn off layer fan
G1 Z50 F1000	
M400 				;Wait finish move			
G90                             ; absolute 
positioning
G1 X235 Y235
;ENDFOOTER""")

# ----
# CUSTOM START&END GCODE FOR ENDER 3/5 PASTE 3D PRINTERS
panel = Panel(""";HEADER
; Minimal Start_gcode by defect if no panel in input
G21        ; Set to metric [change to G20 if you want 
G90        ; Force coordinates to be absolute relative to the origin
G28 	   ; Force coordinates to be absolute relative to the origin	
;ENDHEADER""")
panel_2 = Panel(""";FOOTER
; Minimal End_gcode by defect if no panel in end_gcode
M107                            ; turn off layer fan	
G90                             ; absolute 
positioning
;ENDFOOTER""")
custom_start_gcode = Data(header)
custom_start_gcode_2 = Data(footer)
null = NullItem(Item=custom_start_gcode)  # -> NullFlags, InvalidFlags, Description
null_2 = NullItem(Item=custom_start_gcode_2)  # -> NullFlags, InvalidFlags, Description
ma = MassMultiplication(Input=null.NullFlags)  # -> Result, PartialResults
ma_2 = MassMultiplication(Input=null_2.NullFlags)  # -> Result, PartialResults
stream_filter = StreamFilter(Gate=ma.Result, Stream0=custom_start_gcode, Stream1=panel)
stream_filter_2 = StreamFilter(Gate=ma_2.Result, Stream0=custom_start_gcode_2, Stream1=panel_2)
merge = Merge(Data1=stream_filter, Data2=stream_filter_2)  # -> graft(Result)
start_endgcode = Data(merge)

start_endgcode_2 = ClusterOutput(start_endgcode)
